# Dynamo graph DUCT OFFSET FOR CLASHES.dyn (Dynamo 2.19.3.6394)
# packages: Genius Loci 2024.2.26, Clockwork for Dynamo 2.x 2.6.0, MEPover 2022.10.30

# group: select elements
select_duct = DSModelElementSelection()  # 1 picked in the model; graph input
select_pipe = DSModelElementSelection()  # 1 picked in the model; graph input

# group: check for intersection point
getLocation = Element.GetLocation(element=select_duct)
solids = Element.Solids(element=select_duct)
solids_2 = Element.Solids(element=select_pipe)
intersect = Geometry.Intersect(geometry=solids, other=solids_2)
centroid = Solid.Centroid(solid=intersect)
closestPointTo = Geometry.ClosestPointTo(geometry=getLocation, other=centroid)
direction = Line.Direction(line=getLocation)

# group: split the duct on both sides
split_offset = DoubleInput(800)  # graph input
code_block = CodeBlock(a=split_offset) { -a; }
join = List.Join(list0=code_block, list1=split_offset)
translate = Geometry.Translate(geometry=closestPointTo, direction=direction, distance=join, lacing=Longest)
flatten = List.Flatten(list=translate)
count = List.Count(list=flatten)
cycle = List.Cycle(list=select_duct, amount=count)
split_bypoints = Custom[Split ByPoints](element=cycle, point=flatten)  # package Genius Loci; Split linear elements by points (duct, pipe, column, beam and wall). As many elements as points are required. Works only in Revit 2017 and later.
delete = Element.Delete(element=split_bypoints.Fittings)

code_block_2 = CodeBlock(a=flatten) { a[0]; a[1]; }
join_2 = List.Join(list0=split_bypoints.Parents, list1=split_bypoints.Children)
uniqueItems = List.UniqueItems(list=join_2)
code_block_3 = CodeBlock(a=uniqueItems) { a[2]; }

# group: Get parameter values
code_block_4 = CodeBlock { "Type"; "System Type"; "Width"; "Height"; }
getParameterValueByName = Element.GetParameterValueByName(element=select_duct, parameterName=code_block_4.out0)
getParameterValueByName_2 = Element.GetParameterValueByName(element=select_duct, parameterName=code_block_4.out1)
level = Custom[Element.Level](element=select_duct)  # package Clockwork for Dynamo 2.x; Gets an element's level
getParameterValueByName_3 = Element.GetParameterValueByName(element=select_duct, parameterName=code_block_4.out2)
round = Math.Round(number=getParameterValueByName_3)
getParameterValueByName_4 = Element.GetParameterValueByName(element=select_duct, parameterName=code_block_4.out3)
round_2 = Math.Round(number=getParameterValueByName_4)

# group: draw duct on offset
ZAxis = Vector.ZAxis()
offset_height = DoubleInput(1000)  # graph input
translate_2 = Geometry.Translate(geometry=closestPointTo, direction=ZAxis, distance=offset_height)
byTwoPoints = Vector.ByTwoPoints(start=closestPointTo, end=translate_2)
code_block_5 = CodeBlock { 1500; }
byStartPointDirectionLength = Line.ByStartPointDirectionLength(startPoint=flatten, direction=ZAxis, length=code_block_5)
byLines = Custom[DuctRectangular.ByLines](Lines=byStartPointDirectionLength, DuctType=getParameterValueByName, MechanicalSystemType=getParameterValueByName_2, level=level, Width=round, Height=round_2)  # package MEPover
XAxis = Vector.XAxis()
ZAxis_2 = Vector.ZAxis()
angleAboutAxis = Vector.AngleAboutAxis(vector=XAxis, otherVector=direction, rotationAxis=ZAxis_2)

moveByVector = Element.MoveByVector(element=code_block_3, vector=byTwoPoints)
passthrough = Custom[Passthrough](passThrough=code_block_3, waitFor=moveByVector)  # package Clockwork for Dynamo 2.x; Forces a sequential order of execution. The node wired into the output of the Passthrough node will be executed *after* the node wired into the waitFor input (e.g. important for some Revit operations). The value of the passThrough input will be passed on to the node wired into the output port of the Passthrough node.
element_setrotation = Custom[Element SetRotation](element=byLines, degree=angleAboutAxis)  # package Genius Loci; Set the angle of the element around its local Z-axis. (Same as the Rotate command in Revit)
byMEPCurves = Custom[MEPFitting.ByMEPCurves](MEPCurve1=passthrough, MEPCurve2=element_setrotation, lacing=Longest)  # package MEPover
code_block_6 = CodeBlock(a=element_setrotation) { a[0]; a[1]; }
code_block_7 = CodeBlock(a=uniqueItems) { a[0..1]; }
code_block_8 = CodeBlock(a=code_block_7) { a[0]; a[1]; }
byMEPCurves_2 = Custom[MEPFitting.ByMEPCurves](MEPCurve1=code_block_6.out0, MEPCurve2=code_block_8.out1)
byMEPCurves_3 = Custom[MEPFitting.ByMEPCurves](MEPCurve1=code_block_6.out1, MEPCurve2=code_block_8.out0)
